# Grasshopper definition Bag_parcel_select_from_point_cloud.gh (Grasshopper 0.9.76)
# Copyright: All rights reserved
# plug-ins: Python Interpreter

file = ReadFile(
    File="C:\Users\Pablo\Desktop\Master TU Delft\Year 1\3rd quarter\GEO1004\assignment 1\bag wkt_small.csv",
    PerLineParse=True)
id = Guid(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)
c_script = CSharpScript(id=id)  # -> out, P, N, C; inputs id: Guid
# ---------- c_script: C# ----------
    object obj = RhinoDocument.Objects.Find(id);
    if (obj == null)
      return;

    Rhino.DocObjects.PointCloudObject cloudObject = obj as Rhino.DocObjects.PointCloudObject;
    if (cloudObject == null)
      return;
    PointCloud cloud = cloudObject.PointCloudGeometry;

    List<Point3d> points = new List<Point3d>();
    List<Vector3d> normals = null;
    List<Color> colours = null;

    if (cloud.ContainsNormals)
      normals = new List<Vector3d>();
    if (cloud.ContainsColors)
      colours = new List<Color>();

    foreach (PointCloudItem item in cloud)
    {
      points.Add(item.Location);

      if (normals != null)
        normals.Add(item.Normal);
      if (colours != null)
        colours.Add(item.Color);
    }

    P = points;
    N = normals;
    C = colours;
# ---------- end c_script ----------
python = PythonScript(polygons=file, input_id="8272093", pointcloud=c_script.P)  # -> point_cloud, out_X, out_Y, out_Z, output_points; inputs polygons: list, pointcloud: list of Point3d
# ---------- python: Python ----------
import Rhino.Geometry as rg
import rhinoscriptsyntax as rs
import math as math
import random as random

""" creates a dictionnary containing all the polylines
input: csv file as a string, containing for each polygon a geometry description (WKT format)
and a second part with a unique id
output: a dictionary with all the polygons stored as a Polyline
note: the polyline is in z by default"""
polygon_reg = dict()
linepoints_reg = dict()
for i in range(1,len(polygons)-1):
    raw = polygons[i].split('"')
    coords = raw[1]
    id = raw[2].strip(',')
    coords = coords.strip('POLYGON')
    coords = coords.strip(' ((')
    coords = coords.strip('))')
    coords = coords.split(',')
    points = []
    for x_y in coords:
        x_y = x_y.split(' ')
        points.append(rg.Point3d(float(x_y[0]), float(x_y[1]), 0))
    polygon_reg[id] = rg.Polyline()
    for pt in points:
        polygon_reg[id].Add(pt)
    if polygon_reg[id].IsClosed == False:
        del poly_reg[id]
        print "rejected because not closed", id
    else:
        linepoints_reg[id] = points

point_cloud = rg.PointCloud()
select_id = str(input_id)
color = (random.randint(0,255),random.randint(0,255),random.randint(0,255),1)
bbox = polygon_reg[select_id].BoundingBox
x_min = bbox.GetCorners()[0].X
y_min = bbox.GetCorners()[0].Y
x_max = bbox.GetCorners()[6].X
y_max = bbox.GetCorners()[6].Y
for point in pointcloud:
    x_coord = point.X
    y_coord = point.Y
    if x_coord>x_min and x_coord<x_max and y_coord>y_min and y_coord<y_max:
        test_point = rg.Point3d(x_coord, y_coord, 0)
        inside = bbox.Contains(test_point)
        if inside == True:
            point_cloud.Add(point)
output_points = []
out_X = []
out_Y = []
out_Z = []
for i in range(0, point_cloud.Count):
    point = point_cloud.GetPoints()[i]
    out_X.append(point.X)
    out_Y.append(point.Y)
    out_Z.append(point.Z)
# ---------- end python ----------
pt = ConstructPoint(XCoordinate=python.out_X, YCoordinate=python.out_Y, ZCoordinate=python.out_Z)
preview = CustomPreview(Geometry=pt, Shader=ColourSwatch(SwatchColor=RGB(217, 28, 28)))
