# Grasshopper definition NeighboursPCA.gh (Grasshopper 0.9.76)
# plug-ins: Python Interpreter

id = Guid(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)
c_script = CSharpScript(id=id)  # -> out, P, N, C; inputs id: Guid
# ---------- c_script: C# ----------
    object obj = RhinoDocument.Objects.Find(id);
    if (obj == null)
      return;

    Rhino.DocObjects.PointCloudObject cloudObject = obj as Rhino.DocObjects.PointCloudObject;
    if (cloudObject == null)
      return;
    PointCloud cloud = cloudObject.PointCloudGeometry;

    List<Point3d> points = new List<Point3d>();
    List<Vector3d> normals = null;
    List<Color> colours = null;

    if (cloud.ContainsNormals)
      normals = new List<Vector3d>();
    if (cloud.ContainsColors)
      colours = new List<Color>();

    foreach (PointCloudItem item in cloud)
    {
      points.Add(item.Location);

      if (normals != null)
        normals.Add(item.Normal);
      if (colours != null)
        colours.Add(item.Color);
    }

    P = points;
    N = normals;
    C = colours;
# ---------- end c_script ----------
python = PythonScript(points=c_script.P)  # -> out, a; inputs points: list of Point3d
# ---------- python: Python ----------
a=[]
for i in range(0,600):
    a.append(points[i])
# ---------- end python ----------
python_2 = PythonScript(points=python.a, d=Slider(10, range=0..10))  # -> out, pointsFDN; inputs points: list of Point3d
# ---------- python_2: Python ----------
def FindFND(point,points,thresh):
    #thresh is the distance，float
    neighbours=[]
    x_ref = point.X
    y_ref = point.Y
    z_ref = point.Z
    SELECT = []
    for pt in points:
        if pt.X<x_ref+thresh and pt.X>x_ref-thresh and pt.Y<y_ref+thresh and pt.Y>y_ref-thresh and pt.Z<z_ref+thresh and pt.Z>z_ref-thresh:
            SELECT.append(pt)
    for elem in SELECT:
        if ((x_ref - elem.X)**2+(y_ref - elem.Y)**2+(z_ref - elem.Z)**2) <= thresh**2:
            neighbours.append(elem)
    return neighbours

def FNDpointset(points,thresh):
    final=[]
    for item in points:
        final.append(FindFND(item,points,thresh))
    return final

pointsFDN=FNDpointset(points,d)
print len(pointsFDN[3])
# ---------- end python_2 ----------
python_3 = PythonScript(points=python.a, k=Slider(49, range=3..100))  # -> out, pointsKNN; inputs points: list of Point3d
# ---------- python_3: Python ----------
import copy


def FindKNN(point,pts,k):
    neighs = []
    pts.remove(point)
    thresh =2
    SELECT = []
    jjj=0
    kprime=k
    while len(SELECT)<k:
        x_max = point.X+thresh
        x_min = point.X-thresh
        y_max = point.Y+thresh
        y_min = point.Y-thresh
        z_max = point.Z+thresh
        z_min = point.Z-thresh
        for pt in pts:
            if pt.X<x_max and pt.X>x_min and pt.Y<y_max and pt.Y>y_min and pt.Z<z_max and pt.Z>z_min:
                SELECT.append(pt)
                pts.remove(pt)
        if len(SELECT)==0:
            thresh=10*thresh
            continue
        elif len(SELECT)<kprime:
            ptratio=len(SELECT)/kprime
            thresh = ((1.1/ptratio)**(1/3.0))*thresh
        for elem in SELECT:
             ptDist=((point.X-elem.X)**2+(point.Y-elem.Y)**2+(point.Z-elem.Z)**2)
             if ptDist<thresh**2:
                neighs.append((ptDist,elem))
        if len(neighs)<k:
            ptratio=len(SELECT)/kprime
            kprime=(k/len(neighs))*1.1*kprime
            thresh = ((1.1/ptratio)**(1/3.0))*thresh
    neighs.sort()
    final=[x[1] for x in neighs]
    return final[0:int(k)]



def KNNpointset(points,thresh):
    final=[]
    for item in points:
        pts=[]
        for elem in points:
            pts.append(elem)
        final.append(FindKNN(item,pts,thresh))
    return final


pointsKNN=KNNpointset(points,k)
# ---------- end python_3 ----------
python_4 = PythonScript(points=python_2.pointsFDN)  # -> out, Nvector, sigma; inputs points: list
# ---------- python_4: Python ----------
import clr
clr.AddReference("mtrand.dll")
import scipy
import numpy as np
import math
import Rhino.Geometry as rg


def covMat(points):
    sumx=0
    sumy=0
    sumz=0
    covmat=np.matrix([[0,0,0],[0,0,0],[0,0,0]])
    for pt in points:
        sumx=sumx+pt.X
        sumy=sumy+pt.Y
        sumz=sumz+pt.Z
    cx=sumx/len(points)
    cy=sumy/len(points)
    cz=sumz/len(points)
    covLst=[]
    for pt in points:
        ppbar=np.matrix([[pt.X-cx,pt.Y-cy,pt.Z-cz]])
        ppbart=ppbar.transpose()
        Mat3=np.multiply(ppbart,ppbar)
        covmat=covmat+Mat3
    c=(1/float(len(points)))*covmat
    return c

Nvector=[]
sigma=[]
for item in points:
    a = np.linalg.eig(covMat(item))
    print a
    eigenvalues=list((a[0]))
    eigenvectors=(a[1]).tolist() 
    lamda0=min(eigenvalues)
    index0=eigenvalues.index(lamda0)
    n=(rg.Vector3d(eigenvectors[index0][0],eigenvectors[index0][1],eigenvectors[index0][2]))
    sigma.append(lamda0/float(sum(eigenvalues)))
    Nvector.append(n)

print sigma
# ---------- end python_4 ----------
python_5 = PythonScript(points=python_3.pointsKNN)  # -> out, Nvector, sigma; inputs points: list
# ---------- python_5: Python ----------
import clr
clr.AddReference("mtrand.dll")
import scipy
import numpy as np
import math
import Rhino.Geometry as rg


def covMat(points):
    sumx=0
    sumy=0
    sumz=0
    covmat=np.matrix([[0,0,0],[0,0,0],[0,0,0]])
    for pt in points:
        sumx=sumx+pt.X
        sumy=sumy+pt.Y
        sumz=sumz+pt.Z
    cx=sumx/len(points)
    cy=sumy/len(points)
    cz=sumz/len(points)
    covLst=[]
    for pt in points:
        ppbar=np.matrix([[pt.X-cx,pt.Y-cy,pt.Z-cz]])
        ppbart=ppbar.transpose()
        Mat3=np.multiply(ppbart,ppbar)
        covmat=covmat+Mat3
    c=(1/float(len(points)))*covmat
    return c

Nvector=[]
sigma=[]
for item in points:
    a = np.linalg.eig(covMat(item))
    eigenvalues=list((a[0]))
    eigenvectors=(a[1]).tolist() 
    lamda0=min(eigenvalues)
    index0=eigenvalues.index(lamda0)
    n=(rg.Vector3d(eigenvectors[index0][0],eigenvectors[index0][1],eigenvectors[index0][2]))
    sigma.append(lamda0/float(sum(eigenvalues)))
    Nvector.append(n)

print sigma
# ---------- end python_5 ----------
vdis = VectorDisplay(Anchor=python.a, Vector=python_4.Nvector)
vdis_2 = VectorDisplay(Anchor=python.a, Vector=python_5.Nvector)
