# Grasshopper definition NeighboursPCA_recent.gh (Grasshopper 0.9.76)
# plug-ins: Python Interpreter

number_slider = Slider(3, range=0..50)
number_slider_2 = Slider(3, range=0..50)
number_slider_3 = Slider(3, range=0..50)
number_slider_4 = Slider(10, range=3..100)
number_slider_5 = Slider(1.662, range=0..10)
id = Guid(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)
c_script = CSharpScript(id=id)  # -> out, P, N, C; inputs id: Guid
# ---------- c_script: C# ----------
    object obj = RhinoDocument.Objects.Find(id);
    if (obj == null)
      return;

    Rhino.DocObjects.PointCloudObject cloudObject = obj as Rhino.DocObjects.PointCloudObject;
    if (cloudObject == null)
      return;
    PointCloud cloud = cloudObject.PointCloudGeometry;

    List<Point3d> points = new List<Point3d>();
    List<Vector3d> normals = null;
    List<Color> colours = null;

    if (cloud.ContainsNormals)
      normals = new List<Vector3d>();
    if (cloud.ContainsColors)
      colours = new List<Color>();

    foreach (PointCloudItem item in cloud)
    {
      points.Add(item.Location);

      if (normals != null)
        normals.Add(item.Normal);
      if (colours != null)
        colours.Add(item.Color);
    }

    P = points;
    N = normals;
    C = colours;
# ---------- end c_script ----------
python = PythonScript(pts=c_script.P, Sx=number_slider, Sy=number_slider_2, Sz=number_slider_3, k_sel=number_slider_4, d=number_slider_5)  # -> out, sql_command, voxelSet, pointsFDN, pointsKNN; inputs pts: list of Point3d
# ---------- python: Python ----------
import Rhino.Geometry as rg
import math as math

def pts2Lst(pts):
    x=[]
    y=[]
    z=[]
    for item in pts:
        x.append(item.X)
        y.append(item.Y)
        z.append(item.Z)
    return [x,y,z]

def bbox(x,y,z):
    """Returns description of tight fitting axis-aligned box 
    around a set of 3D points

    arguments:

      pts - list of 3D points

    returns:

      list with 2 lists - [[xmin, ymin, zmin], [xmax, ymax, zmax]]
    """
    minT=(min(x),min(y),min(z))
    maxT=(max(x),max(y),max(z))
    return [minT,maxT]


def rbbox2zbbox(pmin,pmax,s):
    return [minRp2Zp(pmin,s),maxRp2Zp(pmax,s)]

def minRp2Zp(pmin,s):
    x1=s[0]*math.ceil(pmin[0]/s[0])
    y1=s[1]*math.ceil(pmin[1]/s[1])
    z1=s[2]*math.ceil(pmin[2]/s[2])
    return [x1,y1,z1]


def maxRp2Zp(pmax,s):
    x2=s[0]*math.floor(pmax[0]/s[0])
    y2=s[1]*math.floor(pmax[1]/s[1])
    z2=s[2]*math.floor(pmax[2]/s[2])
    return [x2,y2,z2]

def pc2Voxel(pts,s):
    x,y,z=pts2Lst(pts)
    pointsbbx=bbox(x,y,z)
    pmin=pointsbbx[0]
    pmax=pointsbbx[1]
    zbbox=rbbox2zbbox(pmin,pmax,s)
    cx=int(math.floor((zbbox[1][0]-zbbox[0][0])/s[0]))
    cy=int(math.floor((zbbox[1][1]-zbbox[0][1])/s[1]))
    cz=int(math.floor((zbbox[1][2]-zbbox[0][2])/s[2]))
    boolDict={}
    countDict={}
    pointDict={}
    voxels=[]
    for i in range(-1,cx+1):
        for j in range(-1,cy+1):
            for k in range(-1,cz+1):
                boolDict[(i,j,k)]=0
                countDict[(i,j,k)]=0
                pointDict[(i,j,k)]=[]
    for n in range(0,len(x)):
         i=int(math.floor((x[n]-zbbox[0][0])/s[0]))
         j=int(math.floor((y[n]-zbbox[0][1])/s[1]))
         k=int(math.floor((z[n]-zbbox[0][2])/s[2]))
         countDict[(i,j,k)]+=1
         pointDict[(i,j,k)].append(rg.Point3d(x[n],y[n],z[n]))
         if boolDict[(i,j,k)]==0:
            xp=i*s[0]+s[0]/2.0+zbbox[0][0]
            yp=j*s[1]+s[1]/2.0+zbbox[0][1]
            zp=k*s[2]+s[2]/2.0+zbbox[0][2]
            newPoint=rg.Point3d(xp,yp,zp)
            voxels.append(newPoint)
    sql_command = xport2sql(boolDict,s,zbbox)
    return voxels, sql_command, countDict, pointDict, zbbox

def xport2sql(dict,s,zbbox,on=1):
    voxel2xport = "create table voxels(i_coord int, j_coord int, k_coord int);\n"+"create table voxelsmeta(x_coord float, y_coord float, z_coord float);\n"
    for key in dict:
        if dict[key]==1:
            voxel2xport=voxel2xport+"insert into voxels values ({}, {}, {});\n".format(key[0], key[1], key[2])
    voxel2xport=voxel2xport+"insert into voxelsmeta values({}, {}, {});\n".format(zbbox[0][0],zbbox[0][1],zbbox[0][2])
    voxel2xport=voxel2xport+"insert into voxelsmeta values({}, {}, {});\n".format(zbbox[1][0],zbbox[1][1],zbbox[1][2])
    voxel2xport=voxel2xport+"insert into voxelsmeta values({}, {}, {});\n".format(s[0],s[1],s[2])
    return voxel2xport

s=[Sx,Sy,Sz]
voxelSet= pc2Voxel(pts,s)[0]
sql_command = pc2Voxel(pts,s)[1]
pointDict = pc2Voxel(pts,s)[3]
zbbox = pc2Voxel(pts,s)[4]

points10=[]
for i in range(0,10000):
    points10.append(pts[i])

###################PART ON KNN############################
def FindKNN(point,pts,k_sel,pointDict,S,zbbox):
    #initialize variables
    neighs = []
    SELECT = []
    kprime=k_sel
    #find the location of the point
    voxel_i = int(math.floor((point.X-zbbox[0][0])/S[0]))
    voxel_j = int(math.floor((point.Y-zbbox[0][1])/S[1]))
    voxel_k = int(math.floor((point.Z-zbbox[0][2])/S[2]))
    #make a first density estimation and calculate threshold, number of neighbor voxels
    thresh=k_sel/(len(pointDict[(voxel_i, voxel_j, voxel_k)])/(S[0]*S[1]*S[2]))**(1/3.0)
    n=int(math.ceil(thresh/min(S)))
    #start with the bounding box selection of points
    while len(neighs)<k_sel:
        Select=[]
        x_max = point.X+thresh
        x_min = point.X-thresh
        y_max = point.Y+thresh
        y_min = point.Y-thresh
        z_max = point.Z+thresh
        z_min = point.Z-thresh
        for i in range(voxel_i-n,voxel_i+n):
            for j in range(voxel_j-n,voxel_j+n):
                for k in range(voxel_k-n,voxel_k+n):
                    if pointDict.has_key((i,j,k))==True:
                        for pt in pointDict[(i,j,k)]:
                            if pt.X<x_max and pt.X>x_min and pt.Y<y_max and pt.Y>y_min and pt.Z<z_max and pt.Z>z_min:
                                SELECT.append(pt)
        if len(SELECT)==0:
            thresh=10*thresh
            continue
        elif len(SELECT)<kprime:
            ptratio=len(SELECT)/kprime
            thresh = ((1.1/ptratio)**(1/3.0))*thresh
            n=int(math.ceil(thresh/min(S)))
            continue
        for elem in SELECT:
             ptDist=((point.X-elem.X)**2+(point.Y-elem.Y)**2+(point.Z-elem.Z)**2)
             if ptDist<thresh**2:
                neighs.append((ptDist,elem))
        if len(neighs)<k_sel:
            ptratio=len(SELECT)/kprime
            kprime=(k_sel/len(neighs))*1.1*kprime
            thresh = ((1.1/ptratio)**(1/3.0))*thresh
            n=int(math.ceil(thresh/min(S)))
    neighs.sort()
    final=[x[1] for x in neighs]
    return final[0:int(k_sel)]

def KNNpointset(points_sel,k_sel,pointDict,S,zbbox):
    final=[]
    for item in points_sel:
        pts=[]
        final.append(FindKNN(item,points_sel,k_sel,pointDict,S,zbbox))
    return final

S=[Sx,Sy,Sz]
pointsKNN=KNNpointset(points10,k_sel,pointDict,S,zbbox)
"""
##########FDN Part########################
def FindFDN(point,pointDict,thresh,S):
    #thresh is the distance，float
    neighbours=[]
    SELECT = []
    voxel_points=[]
    x_ref = point.X
    y_ref = point.Y
    z_ref = point.Z
    n = int(math.ceil(thresh/min(S)))
    #print n
    voxel_i = int(math.floor((x_ref-zbbox[0][0])/S[0]))
    voxel_j = int(math.floor((y_ref-zbbox[0][1])/S[1]))
    voxel_k = int(math.floor((z_ref-zbbox[0][2])/S[2]))
    #print voxel_i, voxel_j, voxel_k
    for i in range(voxel_i-n,voxel_i+n):
        for j in range(voxel_j-n,voxel_j+n):
            for k in range(voxel_k-n,voxel_k+n):
                if pointDict.has_key((i,j,k))==True:
                    for pt in pointDict[(i,j,k)]:
                        if pt.X<x_ref+thresh and pt.X>x_ref-thresh and pt.Y<y_ref+thresh and pt.Y>y_ref-thresh and pt.Z<z_ref+thresh and pt.Z>z_ref-thresh:
                            SELECT.append(pt)
    for elem in SELECT:
        if ((x_ref - elem.X)**2+(y_ref - elem.Y)**2+(z_ref - elem.Z)**2) <= thresh**2:
            neighbours.append(elem)
    return neighbours

def FDNpointset(points,thresh,pointDict,S):
    final=[]
    for item in points:
        final.append(FindFDN(item,pointDict,thresh,S))
    return final

S=[Sx,Sy,Sz]
pointsFDN=FDNpointset(points10,d,pointDict,S)
print type(pointsFDN)
"""
# ---------- end python ----------
python_2 = PythonScript(points=c_script.P)  # -> out, a; inputs points: list of Point3d
# ---------- python_2: Python ----------
a=[]
for i in range(0,10000):
    a.append(points[i])
# ---------- end python_2 ----------
box = CenterBox(Base=python.voxelSet, X=expr("x/2", number_slider), Y=expr("x/2", number_slider_2), Z=expr("x/2", number_slider_3))  # disabled
python_3 = PythonScript(points=python_2.a, d=number_slider_5)  # -> out, pointsFDN; inputs points: list of Point3d
# ---------- python_3: Python ----------
def FindFND(point,points,thresh):
    #thresh is the distance，float
    neighbours=[]
    x_ref = point.X
    y_ref = point.Y
    z_ref = point.Z
    SELECT = []
    for pt in points:
        if pt.X<x_ref+thresh and pt.X>x_ref-thresh and pt.Y<y_ref+thresh and pt.Y>y_ref-thresh and pt.Z<z_ref+thresh and pt.Z>z_ref-thresh:
            SELECT.append(pt)
    for elem in SELECT:
        if ((x_ref - elem.X)**2+(y_ref - elem.Y)**2+(z_ref - elem.Z)**2) <= thresh**2:
            neighbours.append(elem)
    return neighbours

def FNDpointset(points,thresh):
    final=[]
    for item in points:
        final.append(FindFND(item,points,thresh))
    return final

pointsFDN=FNDpointset(points,d)
print pointsFDN
# ---------- end python_3 ----------
python_4 = PythonScript(points=python_2.a, k=number_slider_4)  # -> out, pointsKNN; inputs points: list of Point3d; disabled
# ---------- python_4: Python ----------
import copy


def FindKNN(point,pts,k):
    neighs = []
    pts.remove(point)
    thresh =2
    SELECT = []
    jjj=0
    kprime=k
    while len(SELECT)<k:
        x_max = point.X+thresh
        x_min = point.X-thresh
        y_max = point.Y+thresh
        y_min = point.Y-thresh
        z_max = point.Z+thresh
        z_min = point.Z-thresh
        for pt in pts:
            if pt.X<x_max and pt.X>x_min and pt.Y<y_max and pt.Y>y_min and pt.Z<z_max and pt.Z>z_min:
                SELECT.append(pt)
                pts.remove(pt)
        if len(SELECT)==0:
            thresh=10*thresh
            continue
        elif len(SELECT)<kprime:
            ptratio=len(SELECT)/kprime
            thresh = ((1.1/ptratio)**(1/3.0))*thresh
        for elem in SELECT:
             ptDist=((point.X-elem.X)**2+(point.Y-elem.Y)**2+(point.Z-elem.Z)**2)
             if ptDist<thresh**2:
                neighs.append((ptDist,elem))
        if len(neighs)<k:
            ptratio=len(SELECT)/kprime
            kprime=(k/len(neighs))*1.1*kprime
            thresh = ((1.1/ptratio)**(1/3.0))*thresh
    neighs.sort()
    final=[x[1] for x in neighs]
    return final[0:int(k)]



def KNNpointset(points,thresh):
    final=[]
    for item in points:
        pts=[]
        for elem in points:
            pts.append(elem)
        final.append(FindKNN(item,pts,thresh))
    return final


pointsKNN=KNNpointset(points,k)
# ---------- end python_4 ----------
python_5 = PythonScript(points=python.pointsFDN)  # -> out, Nvector, sigma; inputs points: list; disabled
# ---------- python_5: Python ----------
import clr
clr.AddReference("mtrand.dll")
import scipy
import numpy as np
import math
import Rhino.Geometry as rg


def covMat(points):
    sumx=0
    sumy=0
    sumz=0
    covmat=np.matrix([[0,0,0],[0,0,0],[0,0,0]])
    for pt in points:
        sumx=sumx+pt.X
        sumy=sumy+pt.Y
        sumz=sumz+pt.Z
    cx=sumx/len(points)
    cy=sumy/len(points)
    cz=sumz/len(points)
    covLst=[]
    for pt in points:
        ppbar=np.matrix([[pt.X-cx,pt.Y-cy,pt.Z-cz]])
        ppbart=ppbar.transpose()
        Mat3=np.multiply(ppbart,ppbar)
        covmat=covmat+Mat3
    c=(1/float(len(points)))*covmat
    return c

Nvector=[]
sigma=[]
for item in points:
    a = np.linalg.eig(covMat(item))
    eigenvalues=list((a[0]))
    eigenvectors=(a[1]).tolist() 
    lamda0=min(eigenvalues)
    index0=eigenvalues.index(lamda0)
    if eigenvectors[index0][2]>0:
        n=(rg.Vector3d(eigenvectors[index0][0],eigenvectors[index0][1],eigenvectors[index0][2]))
    else:
        n=(rg.Vector3d(-eigenvectors[index0][0],-eigenvectors[index0][1],-eigenvectors[index0][2]))
    sigma.append(lamda0/float(sum(eigenvalues)))
    Nvector.append(n)

print sigma
# ---------- end python_5 ----------
python_6 = PythonScript(points=python.pointsKNN)  # -> out, Nvector, sigma; inputs points: list; same code as python_5
vdis = VectorDisplay(Anchor=python_2.a, Vector=python_5.Nvector)  # disabled
vdis_2 = VectorDisplay(Anchor=python_2.a, Vector=python_6.Nvector)
