# Grasshopper definition QuadMeshTriangulationPCA.gh (Grasshopper 0.9.76)
# Copyright: All rights reserved
# plug-ins: Python Interpreter, SlingshotDB

id = Guid(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)
number_slider = Slider(10, range=0..50)
number_slider_2 = Slider(10, range=0..50)
number_slider_3 = Slider(10, range=0..50)
c_script = CSharpScript(id=id)  # -> out, P, N, C; inputs id: Guid
# ---------- c_script: C# ----------
    object obj = RhinoDocument.Objects.Find(id);
    if (obj == null)
      return;

    Rhino.DocObjects.PointCloudObject cloudObject = obj as Rhino.DocObjects.PointCloudObject;
    if (cloudObject == null)
      return;
    PointCloud cloud = cloudObject.PointCloudGeometry;

    List<Point3d> points = new List<Point3d>();
    List<Vector3d> normals = null;
    List<Color> colours = null;

    if (cloud.ContainsNormals)
      normals = new List<Vector3d>();
    if (cloud.ContainsColors)
      colours = new List<Color>();

    foreach (PointCloudItem item in cloud)
    {
      points.Add(item.Location);

      if (normals != null)
        normals.Add(item.Normal);
      if (colours != null)
        colours.Add(item.Color);
    }

    P = points;
    N = normals;
    C = colours;
# ---------- end c_script ----------
python = PythonScript(pts=c_script.P, Sx=number_slider_3, Sy=number_slider, Sz=number_slider_2)  # -> out, sql_command, meta, voxelSet, ijk; inputs pts: list of Point3d
# ---------- python: Python ----------
import Rhino.Geometry as rg
import math as math

def pts2Lst(pts):
    x=[]
    y=[]
    z=[]
    for item in pts:
        x.append(item.X)
        y.append(item.Y)
        z.append(item.Z)
    return [x,y,z]

def bbox(x,y,z):
    """Returns description of tight fitting axis-aligned box 
    around a set of 3D points

    arguments:

      pts - list of 3D points

    returns:

      list with 2 lists - [[xmin, ymin, zmin], [xmax, ymax, zmax]]
    """
    minT=(min(x),min(y),min(z))
    maxT=(max(x),max(y),max(z))
    return [minT,maxT]


def rbbox2zbbox(pmin,pmax,s):
    return [minRp2Zp(pmin,s),maxRp2Zp(pmax,s)]

def minRp2Zp(pmin,s):
    x1=s[0]*math.ceil(pmin[0]/s[0])
    y1=s[1]*math.ceil(pmin[1]/s[1])
    z1=s[2]*math.ceil(pmin[2]/s[2])
    return [x1,y1,z1]


def maxRp2Zp(pmax,s):
    x2=s[0]*math.floor(pmax[0]/s[0])
    y2=s[1]*math.floor(pmax[1]/s[1])
    z2=s[2]*math.floor(pmax[2]/s[2])
    return [x2,y2,z2]

def pc2Voxel(pts,s):
    x,y,z=pts2Lst(pts)
    pointsbbx=bbox(x,y,z)
    pmin=pointsbbx[0]
    pmax=pointsbbx[1]
    zbbox=rbbox2zbbox(pmin,pmax,s)
    cx=int(math.floor((zbbox[1][0]-zbbox[0][0])/s[0]))
    cy=int(math.floor((zbbox[1][1]-zbbox[0][1])/s[1]))
    cz=int(math.floor((zbbox[1][2]-zbbox[0][2])/s[2]))
    boolDict={}
    voxels=[]
    for i in range(-1,cx+1):
        for j in range(-1,cy+1):
            for k in range(-1,cz+1):
                boolDict[(i,j,k)]=0
    for n in range(0,len(x)):
         i=int(math.floor((x[n]-zbbox[0][0])/s[0]))
         j=int(math.floor((y[n]-zbbox[0][1])/s[1]))
         k=int(math.floor((z[n]-zbbox[0][2])/s[2]))
         if boolDict[(i,j,k)]==0:
            boolDict[(i,j,k)]=1
            xp=i*s[0]+s[0]/2.0+zbbox[0][0]
            yp=j*s[1]+s[1]/2.0+zbbox[0][1]
            zp=k*s[2]+s[2]/2.0+zbbox[0][2]
            newPoint=rg.Point3d(xp,yp,zp)
            voxels.append(newPoint)
    metadata=[[zbbox[0][0],zbbox[0][1],zbbox[0][2]],[s[0],s[1],s[2]]]
    sql_command = xport2sql(boolDict,s,zbbox)
    
    return voxels, sql_command, boolDict,metadata

def xport2sql(dict,s,zbbox,on=1):
    voxel2xport = "create table voxels(i_coord int, j_coord int, k_coord int);\n"+"create table voxelsmeta(x_coord float, y_coord float, z_coord float);\n"
    for key in dict:
        if dict[key]==1:
            voxel2xport=voxel2xport+"insert into voxels values ({}, {}, {});\n".format(key[0], key[1], key[2])
    voxel2xport=voxel2xport+"insert into voxelsmeta values({}, {}, {});\n".format(zbbox[0][0],zbbox[0][1],zbbox[0][2])
    voxel2xport=voxel2xport+"insert into voxelsmeta values({}, {}, {});\n".format(zbbox[1][0],zbbox[1][1],zbbox[1][2])
    voxel2xport=voxel2xport+"insert into voxelsmeta values({}, {}, {});\n".format(s[0],s[1],s[2])
    return voxel2xport

s=[Sx,Sy,Sz]
voxeloutputs = pc2Voxel(pts,s)
voxelSet= voxeloutputs[0]
sql_command = voxeloutputs[1]
boolDict = voxeloutputs [2]
meta=voxeloutputs [3]
ijk=[]
for key in boolDict:
    if boolDict[key]==1:
        ijk.append(key)
# ---------- end python ----------
box = CenterBox(Base=python.voxelSet, X=expr("x/2", number_slider_3), Y=expr("x/2", number_slider), Z=expr("x/2", number_slider_2))
python_2 = PythonScript(ijk=python.ijk, meta=python.meta)  # -> out, TopIJK, TopXYZ, Quadmesh; inputs ijk: list, meta: list
# ---------- python_2: Python ----------
import Rhino.Geometry as rg
import math as math

def topLayer(ijk):
    topZ=dict()
    min_i= min(ijk,key=lambda item:item[0])[0]
    min_j= min(ijk,key=lambda item:item[1])[1]
    max_i= max(ijk,key=lambda item:item[0])[0]
    max_j= max(ijk,key=lambda item:item[1])[1]
    for i in range(min_i,max_i+1):
        for j in range(min_j,max_j+1):
            ij=filter(lambda x : x[0] == i and x[1]==j, ijk)
            if len(ij)!=0:
                topZ[(i,j)]=max(ij,key=lambda item:item[2])[2]
    return topZ,min_i,min_j,max_i, max_j


def create_list(TopIJK, i_min, i_max, j_max, j_min):
    outlist=[]
    k_min = min(TopIJK, key=TopIJK.get)
    for i in range(i_min,i_max+1):
        for j in range(j_min,j_max+1):
            if TopIJK.has_key((i,j)) == True:
                outlist.append((i,j,TopIJK[(i,j)]))
            if TopIJK.has_key((i,j)) == False:
                TopIJK[(i,j)]=TopIJK[k_min]
            outlist.append((i,j,TopIJK[(i,j)]))
    return outlist

def create_mesh(coord_list, i_min, i_max, j_max, j_min, s, zbbox):
    m = rg.Mesh()
    v=[]
    for point in coord_list:
        m.Vertices.Add(point[0]*s[0]+s[0]/2.0+zbbox[0][0], point[1]*s[1]+s[1]/2.0+zbbox[0][1], point[2]*s[2]+s[2]/2.0+zbbox[0][2])
    i_diff = i_max-i_min+1
    j_diff = j_max-j_min+1
    rowcnt = 0
    for i in range(0,len(coord_list)-i_diff-1):
        if i ==(rowcnt+(rowcnt+1)*i_diff):
            rowcnt+=1
        else:
            m.Faces.AddFace(i,i+1,i+1+i_diff+1,i+i_diff+1)
    return m


s=[meta[1][0],meta[1][1],meta[1][1]]
zbbox=[[meta[0][1],meta[0][1],meta[0][2]]]

TopIJK, i_min, j_min, i_max, j_max=topLayer(ijk)
coord_list = create_list(TopIJK, i_min, i_max, j_max, j_min)
Quadmesh = create_mesh(coord_list, i_min, i_max, j_max, j_min,s,zbbox)
# ---------- end python_2 ----------
box_2 = CenterBox(Base=PlaneXY(0, 0, 0), X=1, Y=1, Z=1)
medges = MeshEdges(Mesh=python_2.Quadmesh)  # -> NakedEdges, InteriorEdges, NonManifoldEdges
demesh = DeconstructMesh(Mesh=python_2.Quadmesh)  # -> Vertices, Faces, Colours, Normals
panel = Panel(python.sql_command)

# ---- group: put some dummy data in that table / Demo dummy data
series = Series(Start=0, Step=1, Count=10)

# ---- group: make a suitable connection string
pgstring = PostgreSQLConnectionString(
    Server="localhost",
    Port="5432",
    UserID="postgres",
    Password="Sms20366990!",
    Database="3d",
    CommandTimeout="20",
    ConnnectionTimeout="5")
patch = VBScript(CString=pgstring)  # -> out, A
# ---------- patch: VB ----------
    '   Patch developed by MSc Geomatics, Rusne Sileryte, in June 2014

    Dim CSList() As  String
    CSList = Cstring.Split(";")
    CSlist(0) = "Driver={PostgreSQL ODBC Driver(UNICODE)}"
    Dim CS As String
    CS = String.Join(";", CSlist)
    A = CS
# ---------- end patch ----------

# ----
number_slider_4 = Slider(0.25, range=0..1)

# ---- group: put some dummy data in that table / Demo dummy data
series_2 = Series(Start=0, Step=1, Count=10)

# ---- group: First
toggle = BooleanToggle(True)

# ---- group: Create a table
panel_2 = Panel("tabletest")
createtb = SQLCreateTable(TableName=panel_2, Columns="C1 INT NOT NULL , PRIMARY KEY(C1)", DropTable=False)
cstring = Text(patch.A)
odbccommand = ODBCCommand(ConnectionString=cstring, ConnectToggle=toggle, Command=panel)

# ---- group: query your data
querysfw = SQLSELECTString(Select="C1", From=panel_2, Where="C1>5")
odbc_query = ODBCQuery(ConnectString=cstring, ConnectToggle=Toggle(True), Query="select * from voxelsmeta;", ColumnNumber=0)  # -> Exceptions, ColumnQueryResult, QueryResult

# ---- group: put some dummy data in that table
insert = SQLInsertCommand(Table=panel_2, Columns="C1", Data=series, Update=False)
odbccommand_2 = ODBCCommand(ConnectionString=cstring, ConnectToggle=Button(), Command=insert)

# ----
panel_3 = Panel(odbc_query.Exceptions)
panel_4 = Panel(odbccommand_2)

# ---- group: query your data
querysfw_2 = SQLSELECTString(Select="C1", From=panel_2, Where="C1>5")
odbc_query_2 = ODBCQuery(ConnectString=cstring, ConnectToggle=Toggle(True), Query="select * from voxels;", ColumnNumber=0)  # -> Exceptions, ColumnQueryResult, QueryResult

# ---- group: put some dummy data in that table
insert_2 = SQLInsertCommand(Table=panel_2, Columns="C1", Data=series_2, Update=False)
odbccommand_3 = ODBCCommand(ConnectionString=cstring, ConnectToggle=Button(), Command=insert_2)

# ----
panel_5 = Panel(odbccommand)
number_slider_5 = Slider(0.25, range=0..1)
panel_6 = Panel(odbc_query_2.Exceptions)
panel_7 = Panel(odbc_query_2.QueryResult)
panel_8 = Panel(odbccommand_3)
python_3 = PythonScript(qresult=panel_7, meta=odbc_query.QueryResult)  # -> out, voxels, sx, sy, sz; inputs qresult: list, meta: list
# ---------- python_3: Python ----------
import Rhino.Geometry as rg
import math as math
indeces=[]

for row in qresult:
    v=row.split(",")
    i=int(v[0])
    j=int(v[1])
    k=int(v[2])
    indeces.append((i,j,k))

metadata=[]
for item in meta:
    m=item.split(",")
    ii=int(m[0])
    jj=int(m[1])
    kk=int(m[2])
    metadata.append((ii,jj,kk))

s=[metadata[2][0],metadata[2][1],metadata[2][1]]
zbbox=[[metadata[0][1],metadata[0][1],metadata[0][2]],[metadata[1][0],metadata[1][1],metadata[1][2]]]

voxels=[]
for i in range(0,len(indeces)): 
    xp=indeces[i][0]*s[0]+s[0]/2.0+zbbox[0][0]
    yp=indeces[i][1]*s[1]+s[1]/2.0+zbbox[0][1]
    zp=indeces[i][2]*s[2]+s[2]/2.0+zbbox[0][2]
    newPoint=rg.Point3d(xp,yp,zp)
    voxels.append(newPoint)

sx=metadata[2][0]
sy=metadata[2][1]
sz=metadata[2][1]
# ---------- end python_3 ----------
box_3 = CenterBox(Base=python_3.voxels, X=expr("x/2", python_3.sx), Y=expr("x/2", python_3.sy), Z=expr("x/2", python_3.sz))
