# Grasshopper definition QuadMeshTriangulationPCANoDB.gh (Grasshopper 0.9.76)
# Copyright: All rights reserved
# plug-ins: Python Interpreter

id = Guid(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)
number_slider = Slider(10, range=0..50)
number_slider_2 = Slider(10, range=0..50)
number_slider_3 = Slider(10, range=0..50)
c_script = CSharpScript(id=id)  # -> out, P, N, C; inputs id: Guid
# ---------- c_script: C# ----------
    object obj = RhinoDocument.Objects.Find(id);
    if (obj == null)
      return;

    Rhino.DocObjects.PointCloudObject cloudObject = obj as Rhino.DocObjects.PointCloudObject;
    if (cloudObject == null)
      return;
    PointCloud cloud = cloudObject.PointCloudGeometry;

    List<Point3d> points = new List<Point3d>();
    List<Vector3d> normals = null;
    List<Color> colours = null;

    if (cloud.ContainsNormals)
      normals = new List<Vector3d>();
    if (cloud.ContainsColors)
      colours = new List<Color>();

    foreach (PointCloudItem item in cloud)
    {
      points.Add(item.Location);

      if (normals != null)
        normals.Add(item.Normal);
      if (colours != null)
        colours.Add(item.Color);
    }

    P = points;
    N = normals;
    C = colours;
# ---------- end c_script ----------
python = PythonScript(pts=c_script.P, Sx=number_slider_3, Sy=number_slider, Sz=number_slider_2)  # -> out, sql_command, meta, voxelSet, ijk; inputs pts: list of Point3d
# ---------- python: Python ----------
import Rhino.Geometry as rg
import math as math

def pts2Lst(pts):
    x=[]
    y=[]
    z=[]
    for item in pts:
        x.append(item.X)
        y.append(item.Y)
        z.append(item.Z)
    return [x,y,z]

def bbox(x,y,z):
    """Returns description of tight fitting axis-aligned box 
    around a set of 3D points

    arguments:

      pts - list of 3D points

    returns:

      list with 2 lists - [[xmin, ymin, zmin], [xmax, ymax, zmax]]
    """
    minT=(min(x),min(y),min(z))
    maxT=(max(x),max(y),max(z))
    return [minT,maxT]


def rbbox2zbbox(pmin,pmax,s):
    return [minRp2Zp(pmin,s),maxRp2Zp(pmax,s)]

def minRp2Zp(pmin,s):
    x1=s[0]*math.ceil(pmin[0]/s[0])
    y1=s[1]*math.ceil(pmin[1]/s[1])
    z1=s[2]*math.ceil(pmin[2]/s[2])
    return [x1,y1,z1]


def maxRp2Zp(pmax,s):
    x2=s[0]*math.floor(pmax[0]/s[0])
    y2=s[1]*math.floor(pmax[1]/s[1])
    z2=s[2]*math.floor(pmax[2]/s[2])
    return [x2,y2,z2]

def pc2Voxel(pts,s):
    x,y,z=pts2Lst(pts)
    pointsbbx=bbox(x,y,z)
    pmin=pointsbbx[0]
    pmax=pointsbbx[1]
    zbbox=rbbox2zbbox(pmin,pmax,s)
    cx=int(math.floor((zbbox[1][0]-zbbox[0][0])/s[0]))
    cy=int(math.floor((zbbox[1][1]-zbbox[0][1])/s[1]))
    cz=int(math.floor((zbbox[1][2]-zbbox[0][2])/s[2]))
    boolDict={}
    voxels=[]
    for i in range(-1,cx+1):
        for j in range(-1,cy+1):
            for k in range(-1,cz+1):
                boolDict[(i,j,k)]=0
    for n in range(0,len(x)):
         i=int(math.floor((x[n]-zbbox[0][0])/s[0]))
         j=int(math.floor((y[n]-zbbox[0][1])/s[1]))
         k=int(math.floor((z[n]-zbbox[0][2])/s[2]))
         if boolDict[(i,j,k)]==0:
            boolDict[(i,j,k)]=1
            xp=i*s[0]+s[0]/2.0+zbbox[0][0]
            yp=j*s[1]+s[1]/2.0+zbbox[0][1]
            zp=k*s[2]+s[2]/2.0+zbbox[0][2]
            newPoint=rg.Point3d(xp,yp,zp)
            voxels.append(newPoint)
    metadata=[[zbbox[0][0],zbbox[0][1],zbbox[0][2]],[s[0],s[1],s[2]]]
    print metadata
    sql_command = xport2sql(boolDict,s,zbbox)
    
    return voxels, sql_command, boolDict,metadata

def xport2sql(dict,s,zbbox,on=1):
    voxel2xport = "create table voxels(i_coord int, j_coord int, k_coord int);\n"+"create table voxelsmeta(x_coord float, y_coord float, z_coord float);\n"
    for key in dict:
        if dict[key]==1:
            voxel2xport=voxel2xport+"insert into voxels values ({}, {}, {});\n".format(key[0], key[1], key[2])
    voxel2xport=voxel2xport+"insert into voxelsmeta values({}, {}, {});\n".format(zbbox[0][0],zbbox[0][1],zbbox[0][2])
    voxel2xport=voxel2xport+"insert into voxelsmeta values({}, {}, {});\n".format(zbbox[1][0],zbbox[1][1],zbbox[1][2])
    voxel2xport=voxel2xport+"insert into voxelsmeta values({}, {}, {});\n".format(s[0],s[1],s[2])
    return voxel2xport

s=[Sx,Sy,Sz]
voxeloutputs = pc2Voxel(pts,s)
voxelSet= voxeloutputs[0]
sql_command = voxeloutputs[1]
boolDict = voxeloutputs [2]
meta=voxeloutputs [3]
ijk=[]
for key in boolDict:
    if boolDict[key]==1:
        ijk.append(key)
# ---------- end python ----------
python_2 = PythonScript(d=Slider(5, range=0..10))  # -> out, pointsFDN; inputs points: list of Point3d
# ---------- python_2: Python ----------
def FindFND(point,points,thresh):
    #thresh is the distance，float
    neighbours=[]
    x_ref = point.X
    y_ref = point.Y
    z_ref = point.Z
    SELECT = []
    for pt in points:
        if pt.X<x_ref+thresh and pt.X>x_ref-thresh and pt.Y<y_ref+thresh and pt.Y>y_ref-thresh and pt.Z<z_ref+thresh and pt.Z>z_ref-thresh:
            SELECT.append(pt)
    for elem in SELECT:
        if ((x_ref - elem.X)**2+(y_ref - elem.Y)**2+(z_ref - elem.Z)**2) <= thresh**2:
            neighbours.append(elem)
    return neighbours

def FNDpointset(points,thresh):
    final=[]
    for item in points:
        final.append(FindFND(item,points,d))
    return final
# ---------- end python_2 ----------
python_3 = PythonScript(points=python_2.pointsFDN)  # -> out, a; inputs points: list of Point3d
# ---------- python_3: Python ----------
import numpy as np
import math


def covMat(points):
    sumx=0
    sumy=0
    sumz=0
    covmat=np.matrix([[0,0,0],[0,0,0],[0,0,0]])
    for pt in points:
        sumx=sumx+pt.X
        sumy=sumy+pt.Y
        sumz=sumz+pt.Z
    cx=sumx/len(points)
    cy=sumy/len(points)
    cz=sumz/len(points)
    covLst=[]
    for pt in points:
        ppbar=np.matrix([[pt.X-cx,pt.Y-cy,pt.Z-cz]])
        ppbart=ppbar.transpose()
        Mat3=np.multiply(ppbart,ppbar)
        covmat=covmat+Mat3
    c=(1/float(len(points)))*covmat
    return c


a = np.linalg.eig(covMat(points))
eigenvalues=list((a[0]))
eigenvectors=(a[1]).tolist() 
print eigenvectors
# ---------- end python_3 ----------
python_4 = PythonScript(ijk=python.ijk, meta=python.meta)  # -> out, TopIJK, TopXYZ, Quadmesh, vertexNormals, rgvertexN; inputs ijk: list, meta: list
# ---------- python_4: Python ----------
import Rhino.Geometry as rg
import math as math

def topLayer(ijk):
    topZ=dict()
    min_i= min(ijk,key=lambda item:item[0])[0]
    min_j= min(ijk,key=lambda item:item[1])[1]
    max_i= max(ijk,key=lambda item:item[0])[0]
    max_j= max(ijk,key=lambda item:item[1])[1]
    for i in range(min_i,max_i+1):
        for j in range(min_j,max_j+1):
            ij=filter(lambda x : x[0] == i and x[1]==j, ijk)
            if len(ij)!=0:
                topZ[(i,j)]=max(ij,key=lambda item:item[2])[2]
    return topZ,min_i,min_j,max_i, max_j



def create_list(TopIJK, i_min, i_max, j_max, j_min):
    outlist=[]
    k_min = min(TopIJK, key=TopIJK.get)
    for i in range(i_min,i_max+1):
        for j in range(j_min,j_max+1):
            if TopIJK.has_key((i,j)) == True:
                print i,j
                outlist.append((i,j,TopIJK[(i,j)]))
            else:
                print i,j
                TopIJK[(i,j)]=TopIJK[k_min]
                outlist.append((i,j,TopIJK[(i,j)]))
    return outlist

def topLayerCoor(topz,s,zbbox):
    TopXYZ=[]
    for t in topz:
        i=t[0]
        j=t[1]
        k=t[2]
        xp=i*s[0]+s[0]/2.0+zbbox[0][0]
        yp=j*s[1]+s[1]/2.0+zbbox[0][1]
        zp=k*s[2]+s[2]/2.0+zbbox[0][2]
        newPoint=rg.Point3d(xp,yp,zp)
        TopXYZ.append(newPoint)
    return TopXYZ

def create_mesh(coord_list, i_min, i_max, j_max, j_min):
    normalv=[]
    vertexN=[]
    m = rg.Mesh()
    v=[]
    j=0
    for point in coord_list:
        m.Vertices.Add(point.X,point.Y,point.Z)
        vertexN.append([0,0,0,0])
        j=j+1
    i_diff = i_max-i_min
    j_diff = j_max-j_min
    rowcnt = 0
    for i in range(0,len(coord_list)-j_diff-1):
        if i ==(rowcnt+(rowcnt+1)*j_diff):
            rowcnt+=1
        else:
            m.Faces.AddFace(i,i+j_diff+1,i+1+j_diff+1,i+1)
            QuadN=Vnorm([i,i+j_diff+1,i+1+j_diff+1,i+1],coord_list)
            normalv.append(QuadN)
            for vIndex in [i,i+j_diff+1,i+1+j_diff+1,i+1]:
                vertexN[vIndex][0]=vertexN[vIndex][0]+QuadN[0]
                vertexN[vIndex][1]=vertexN[vIndex][1]+QuadN[1]
                vertexN[vIndex][2]=vertexN[vIndex][2]+QuadN[2]
                vertexN[vIndex][3]=vertexN[vIndex][3]+1
    return m, vertexN

def Vnorm(vlist,point):
    Nx=0
    Ny=0
    Nz=0
    for i in range(0,3):
        Nx=Nx+(point[vlist[i]].Y-point[vlist[i+1]].Y)*(point[vlist[i]].Z+point[vlist[i+1]].Z)
        Ny=Ny+(point[vlist[i]].Z-point[vlist[i+1]].Z)*(point[vlist[i]].X+point[vlist[i+1]].X)
        Nz=Nz+(point[vlist[i]].X-point[vlist[i+1]].X)*(point[vlist[i]].Y+point[vlist[i+1]].Y)
    Nx=Nx+(point[vlist[3]].Y-point[vlist[0]].Y)*(point[vlist[3]].Z+point[vlist[0]].Z)
    Ny=Ny+(point[vlist[3]].Z-point[vlist[0]].Z)*(point[vlist[3]].X+point[vlist[0]].X)
    Nz=Nz+(point[vlist[3]].X-point[vlist[0]].X)*(point[vlist[3]].Y+point[vlist[0]].Y)
    return (Nx,Ny,Nz)


def MeanNorm(Nlist):
    finalList=[]
    for item in Nlist:
        n1=item[0]/item[3]
        n2=item[1]/item[3]
        n3=item[2]/item[3]
        Nm=(n1**2 + n2**2 + n3**2)**0.5
        nx=n1/Nm
        ny=n2/Nm
        nz=n3/Nm
        finalList.append(rg.Vector3d(nx,ny,nz))
    return finalList



s=[meta[1][0],meta[1][1],meta[1][1]]
zbbox=[[meta[0][0],meta[0][1],meta[0][2]]]

TopIJK, i_min, j_min, i_max, j_max=topLayer(ijk)
coord_list = create_list(TopIJK, i_min, i_max, j_max, j_min)
TopXYZ=  topLayerCoor(coord_list,s,zbbox)
Quadmesh, vertexN = create_mesh(TopXYZ, i_min, i_max, j_max, j_min)
vertexNormals = MeanNorm(vertexN)

verN=Quadmesh.Normals.ComputeNormals()
rgvertexN=Quadmesh.Normals
print rgvertexN
# ---------- end python_4 ----------
python_5 = PythonScript(points=c_script.P, k=Slider(3, range=3..10))  # -> out, pointsKNN; inputs points: list of Point3d
# ---------- python_5: Python ----------
def FindKNN(point,points,k):
    neighs = []
    points.remove(point)
    thresh = 1
    SELECT = []
    pts=points
    jjj=0
    kprime=k
    while len(SELECT)<kprime:
        x_max = point.X+thresh
        x_min = point.X-thresh
        y_max = point.Y+thresh
        y_min = point.Y-thresh
        z_max = point.Z+thresh
        z_min = point.Z-thresh
        for pt in points:
            if pt.X<x_max and pt.X>x_min and pt.Y<y_max and pt.Y>y_min and pt.Z<z_max and pt.Z>z_min:
                SELECT.append(pt)
                pts.remove(pt)
        if len(SELECT)==0:
            thresh=10*thresh
            continue
        elif len(SELECT)<kprime:
            ptratio=len(SELECT)/kprime
            thresh = ((1.1/ptratio)**(1/3.0))*thresh
        jjj=jjj+1
        neighs=[]
        for elem in SELECT:
             ptDist=((point.X-elem.X)**2+(point.Y-elem.Y)**2+(point.Z-elem.Z)**2)
             if ptDist<thresh**2:
                neighs.append((ptDist,elem))
        if len(neighs)<k:
            kprime=(k/len(neighs))*1.1*kprime
            thresh = ((1.1/ptratio)**(1/3.0))*thresh
    neighs.sort()
    final=[x[1] for x in neighs]
    return final[0:k]



def KNNpointset(points,thresh):
    final=[]
    for item in points:
        final.append(FindKNN(item,points,k))
    return final
# ---------- end python_5 ----------
box = CenterBox(Base=python_4.TopXYZ, X=expr("X/2", number_slider_3), Y=expr("X/2", number_slider), Z=expr("X/2", number_slider_2))
mesh = Mesh(python_4.Quadmesh)
python_6 = PythonScript(pts=python_4.TopXYZ)  # -> out, triMesh, vertexNormals, rgvertextNormals; inputs pts: list of Point3d
# ---------- python_6: Python ----------
import Rhino.Geometry as rg
import math as math
import clr
clr.AddReference("mtrand")
import scipy
import numpy

def SuperTri(ptLst):
    m = pts[0].X
    for pt in pts:
         xAbs=abs(pt.X)
         yAbs=abs(pt.Y)
         if xAbs>m:
             m=xAbs
         if yAbs>m:
             m=yAbs
         p1=rg.Point3d(10*m,0,0)
         p2=rg.Point3d(0,10*m,0)
         p3=rg.Point3d(-10*m,-10*m,0)
    return (p1,p2,p3)

def delaunayTri(pts):
    points=[]
    for i in range(0,len(pts)):
        points.append([i,pts[i].X,pts[i].Y,pts[i].Z])
    bigTri=SuperTri(pts)
    triTb=[[0,len(pts),len(pts)+1,len(pts)+2,-1,-1,-1]]
    points.append([len(pts),bigTri[0].X,bigTri[0].Y, bigTri[0].Z])
    points.append([len(pts)+1,bigTri[1].X,bigTri[1].Y,bigTri[1].Z])
    points.append([len(pts)+2,bigTri[2].X,bigTri[2].Y,bigTri[2].Z])
    for ii in range(0,len(points)-3):
        k=0
        xp=points[ii][1]
        yp=points[ii][2]
        # In every row of triangulation table
        for j in range(0,len(triTb)):
            a = numpy.linalg.det([[points[triTb[k][2]][1],points[triTb[k][2]][2] ,1 ],[points[triTb[k][1]][1],points[triTb[k][1]][2] ,1 ],[xp,yp,1]])
            b = numpy.linalg.det([[points[triTb[k][3]][1],points[triTb[k][3]][2] ,1 ],[points[triTb[k][2]][1],points[triTb[k][2]][2] ,1 ],[xp,yp,1]])
            c = numpy.linalg.det([[points[triTb[k][1]][1],points[triTb[k][1]][2] ,1 ],[points[triTb[k][3]][1],points[triTb[k][3]][2] ,1 ],[xp,yp,1]])
            #is it inside the current 
            if (a>0 and b>0 and c>0) or (a<0 and b<0 and c<0):
                 tin=k
                 break
            #is it in front of vertex3, find corresponding triangle
            elif ((a>0)and(triTb[k][6]!= -1)):
                k=triTb[k][6]
            #is it in front of vertex1, find corresponding triangle
            elif ((b>0)and(triTb[k][4]!= -1)):
                k=triTb[k][4]
            #is it in front of vertex12, find corresponding triangle
            elif ((c>0)and(triTb[k][5]!= -1)):
                k=triTb[k][5]
        n = len(triTb)
        if triTb[tin][5]!=-1:
            at=triTb[tin][5]
            tk=triTb[at][4:7];
            triTb[at][tk.index(tin)+4]=n
        if triTb[tin][6]!=-1:
            at=triTb[tin][6]
            tk=triTb[at][4:7];
            triTb[at][tk.index(tin)+4]=n+1
        triTb.append([n,points[ii][0],triTb[tin][3],triTb[tin][1],triTb[tin][5],n+1,tin])
        triTb.append([n+1,points[ii][0],triTb[tin][1],triTb[tin][2],triTb[tin][6],tin,n])
        triTb[tin][1]=points[ii][0]
        triTb[tin][5]=n
        triTb[tin][6]=n+1
        q=[n+1,n,tin] 
        while len(q):
            Ro=q[-1]
            T1=triTb[Ro][4]
            if T1!=-1:
                Tr1=triTb[T1][4:7]
                V4=triTb[T1][Tr1.index(Ro)+1]
                Xc=points[V4][1]
                Yc=points[V4][2]
                x1=points[triTb[Ro][1]][1]
                y1=points[triTb[Ro][1]][2]
                x2=points[triTb[Ro][2]][1]
                y2=points[triTb[Ro][2]][2]
                x3=points[triTb[Ro][3]][1]
                y3=points[triTb[Ro][3]][2]
                Ma=[[x1,y1,x1**2+y1**2,1],[x2,y2,x2**2+y2**2,1],[x3,y3,x3**2+y3**2,1],[Xc,Yc,Xc**2+Yc**2,1]]
                De=numpy.linalg.det(Ma)
                if De>0:
                    VA=triTb[Ro][0:3]
                    VA.append(V4)
                    Tr2=triTb[T1][1:4]
                    SS1=triTb[T1][Tr2.index(triTb[Ro][3])+4]
                    VA.append(SS1)
                    VA.append(T1)
                    VA.append(triTb[Ro][6])
                    ##
                    VA1=[T1,triTb[Ro][1],V4,triTb[Ro][3]]
                    Tr3=triTb[T1][1:4]
                    ind1=Tr3.index(VA1[2])
                    ind2=Tr3.index(VA1[3])
                    ind3=3-(ind1+ind2)
                    SS2=triTb[T1][ind3+4]
                    SS3=triTb[Ro][Tr3.index(triTb[T1][2])+4]
                    VA1.append(SS2)
                    VA1.append(triTb[Ro][5])
                    VA1.append(Ro)
                    triTb[Ro]=VA
                    triTb[T1]=VA1
                    if SS1 !=-1:
                        Tr4=triTb[SS1][4:7]
                        triTb[SS1][Tr4.index(T1)+4]=Ro
                    if SS3!=-1:
                        Tr5=triTb[SS3][4:7]
                        triTb[SS3][Tr5.index(Ro)+4]=T1
                    q.append(T1)
                else:
                    q.remove(q[-1])
            else:
                q.remove(q[-1])
    triTb = removeSuperTri(triTb,points)
    mesh = rg.Mesh()
    triNormal=[]
    vertexN=[]
    print len(triTb)
    for i in range(0,len(points)-3):
        mesh.Vertices.Add(points[i][1], points[i][2], points[i][3])
        vertexN.append([0,0,0,0])
    for i in range(0,len(triTb)):
        mesh.Faces.AddFace(triTb[i][1],triTb[i][2],triTb[i][3])
        vlist=triTb[i][1:4]
        triN=Vnorm(vlist,points)
        triNormal.append(Vnorm(vlist,points))
        for vIndex in vlist:
                vertexN[vIndex][0]=vertexN[vIndex][0]+triN[0]
                vertexN[vIndex][1]=vertexN[vIndex][1]+triN[1]
                vertexN[vIndex][2]=vertexN[vIndex][2]+triN[2]
                vertexN[vIndex][3]=vertexN[vIndex][3]+1
    return mesh,vertexN


def filterPoints(pts,factor):
    fltPts=[]
    for i in range(0,len(pts),factor):
        if i<len(pts):
            fltPts.append(pts[i])
    return fltPts

def removeSuperTri(triTb,points):
    for i in range(0,len(triTb)):
        Tr6=triTb[i][1:4]
        n=0
        co=-2
        co1=-2
        co3=-2
        if points[-1][0] in Tr6:
            co=Tr6.index(points[-1][0])
            n=n+1
        if points[-2][0] in Tr6:
            co1=Tr6.index(points[-2][0])
            n=n+1
        if points[-3][0] in Tr6:
            co2=Tr6.index(points[-3][0])
            n=n+1
        if n>1:
            triTb[i]=[0,0,0,0,0,0,0]
        elif n==1:
            if co!=-2:
                cc=co
            elif co1!=-2:
                cc=co1
            elif co2!=-2:
                cc=co2
            hha=triTb[i][cc+4]
            Tr7=triTb[hha][4:7]
            triTb[hha][Tr7.index(triTb[i][0])+4]=-1
            triTb[i]=[0,0,0,0,0,0,0]
    while [0,0,0,0,0,0,0] in triTb:
        triTb.remove([0,0,0,0,0,0,0])
    for i in range(0,len(triTb)):
        kt=triTb[i][0]
        for i in range(0,len(triTb)):
            if kt in triTb[i][4:7]:
                triTb[i][triTb[i][4:7].index(kt)+4]=i
        triTb[i][0]=i
    return triTb


def Vnorm(vlist,point):
    Nx=0
    Ny=0
    Nz=0
    for i in range(0,len(vlist)-1):
        Nx=Nx+(point[vlist[i]][2]-point[vlist[i+1]][2])*(point[vlist[i]][3]+point[vlist[i+1]][3])
        Ny=Ny+(point[vlist[i]][3]-point[vlist[i+1]][3])*(point[vlist[i]][1]+point[vlist[i+1]][1])
        Nz=Nz+(point[vlist[i]][1]-point[vlist[i+1]][1])*(point[vlist[i]][2]+point[vlist[i+1]][2])
    Nx=Nx+(point[vlist[2]][2]-point[vlist[0]][2])*(point[vlist[2]][3]+point[vlist[0]][3])
    Ny=Ny+(point[vlist[2]][3]-point[vlist[0]][3])*(point[vlist[2]][1]+point[vlist[0]][1])
    Nz=Nz+(point[vlist[2]][1]-point[vlist[0]][1])*(point[vlist[2]][2]+point[vlist[0]][2])
    return (Nx,Ny,Nz)

def MeanNorm(Nlist):
    finalList=[]
    for item in Nlist:
        n1=item[0]/item[3]
        n2=item[1]/item[3]
        n3=item[2]/item[3]
        Nm=(n1**2 + n2**2 + n3**2)**0.5
        nx=n1/Nm
        ny=n2/Nm
        nz=n3/Nm
        finalList.append(rg.Vector3d(nx,ny,nz))
    return finalList

#pts=[rg.Point3d(0,0,0),rg.Point3d(0,1,0),rg.Point3d(1,0,0),rg.Point3d(1,1,0)]
#print delaunayTri(pts)
#print len(pts)
#filtered=filterPoints(pts,500)
#print len(filtered)
triMesh, vertexN=delaunayTri(pts)
vertexNormals = MeanNorm(vertexN)
computevector=triMesh.Normals.ComputeNormals()
rgvertextNormals=triMesh.Normals
# ---------- end python_6 ----------
vdis = VectorDisplay(Anchor=python_4.TopXYZ, Vector=python_4.rgvertexN)
vdis_2 = VectorDisplay(Anchor=python_4.TopXYZ, Vector=python_4.vertexNormals)
vdis_3 = VectorDisplay(Anchor=python_4.TopXYZ, Vector=python_6.vertexNormals)
mesh_2 = Mesh(python_6.triMesh)
medges = MeshEdges(Mesh=python_6.triMesh)  # -> NakedEdges, InteriorEdges, NonManifoldEdges
demesh = DeconstructMesh(Mesh=python_6.triMesh)  # -> Vertices, Faces, Colours, Normals
vdis_4 = VectorDisplay(Anchor=python_4.TopXYZ, Vector=python_6.rgvertextNormals)
python_7 = PythonScript()  # -> Out, A
