# Grasshopper definition dealaunay_triangulaton_final.gh (Grasshopper 0.9.76)
# plug-ins: Python Interpreter

numpts = Slider(12, range=2..12)
python = PythonScript(N=Slider(12, range=3..500))  # -> pts, testp, testpp
# ---------- python: Python ----------
import Rhino.Geometry as rg
import math as math
import clr
clr.AddReference("mtrand")
import scipy
import numpy
import random

N=int(N)
R1=500
R2=50
pts=[]
xmin=500
xmax=0
ymin=500
ymax=0
for i in range(N):
    x=R1*random.uniform(0, 1) 
    y=R1*random.uniform(0, 1)
    z=R2*random.uniform(0, 1)
    if x<xmin:
        xmin=x
    if x>xmax:
        xmax=x
    if y<ymin:
        ymin=y
    if y>ymax:
        ymax=y
    pts.append(rg.Point3d(x,y,z))
testp=rg.Point3d((xmin+xmax)/2.0,(ymin+ymax)/2.0,10)
xp=testp.X
yp=testp.Y
testpp=rg.Point3d(xp+100,yp+100,10)
xpp=testpp.X
ypp=testpp.Y
# ---------- end python ----------
python_2 = PythonScript(pts=python.pts, testp=python.testp, testpp=python.testpp, Numpts=numpts, step=Slider(76, range=0..100))  # -> p1box, p2box, bigstep, halfstep, redbox, greenbox, pinkbox, posTb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; inputs pts: list of Point3d, testp: Point3d, testpp: Point3d
# ---------- python_2: Python ----------
import Rhino.Geometry as rg
import math as math
import clr
clr.AddReference("mtrand")
import scipy
import numpy
import random


def Vnorm(vlist,point):
    Nx=0
    Ny=0
    Nz=0
    for i in range(0,len(vlist)-1):
        Nx=Nx+(point[vlist[i]][1]-point[vlist[i+1]][1])*(point[vlist[i]][2]+point[vlist[i+1]][2])
        Ny=Ny+(point[vlist[i]][2]-point[vlist[i+1]][2])*(point[vlist[i]][0]+point[vlist[i+1]][0])
        Nz=Nz+(point[vlist[i]][0]-point[vlist[i+1]][0])*(point[vlist[i]][1]+point[vlist[i+1]][1])
    Nx=Nx+(point[vlist[2]][1]-point[vlist[0]][1])*(point[vlist[2]][2]+point[vlist[0]][2])
    Ny=Ny+(point[vlist[2]][2]-point[vlist[0]][2])*(point[vlist[2]][0]+point[vlist[0]][0])
    Nz=Nz+(point[vlist[2]][0]-point[vlist[0]][0])*(point[vlist[2]][1]+point[vlist[0]][1])
    return (Nx,Ny,Nz)


def SuperTri(pts):
    xmax = pts[0].X
    xmin = pts[0].X
    ymax = pts[0].Y
    ymin = pts[0].Y
    for pt in pts:
        if xmax<pt.X:
            xmax=pt.X
        if xmin>pt.X:
            xmin=pt.X
        if ymax<pt.Y:
            ymax=pt.Y
        if ymin>pt.Y:
            ymin=pt.Y
    bx = xmax-xmin
    by = ymax-ymin
    b = max(bx,by)
    pt1_x = xmin-b-1*b*math.tan(math.pi/6.0)
    pt1_y = ymin-b
    pt2_x = xmax+b+1*b*math.tan(math.pi/6.0) 
    pt2_y = ymin-b
    pt3_x = xmin+b/2.0
    pt3_y = ymax+1*b*math.cos(math.pi/6.0)
    p1=rg.Point3d(pt1_x,pt1_y,0.0)
    p2=rg.Point3d(pt2_x,pt2_y,0.0)
    p3=rg.Point3d(pt3_x,pt3_y,0.0)
    return (p1,p2,p3)


def removeSuperTri(triTb,points):
    bigTri=[]
    for i in range(0,len(triTb)):
        Tr6=triTb[i][1:4]
        n=0
        co=-2
        co1=-2
        co2=-2
        if len(points)-1 in Tr6:
            co=Tr6.index(points[-1][0])
            n=n+1
        if len(points)-2 in Tr6:
            co1=Tr6.index(points[-2][0])
            n=n+1
        if len(points)-3 in Tr6:
            co2=Tr6.index(points[-3][0])
            n=n+1
        if n>0:
            if co!=-2:
                cc=co
                hha=triTb[i][cc+4]
                if hha!=-1:
                    Tr7=triTb[hha][4:7]
                    triTb[hha][Tr7.index(triTb[i][0])+4]=-1
            if co1!=-2:
                cc=co1
                hha=triTb[i][cc+4]
                if hha!=-1:
                    Tr7=triTb[hha][4:7]
                    triTb[hha][Tr7.index(triTb[i][0])+4]=-1           
            if co2!=-2:
                cc=co2
                hha=triTb[i][cc+4]
                if hha!=-1:
                    Tr7=triTb[hha][4:7]
                    triTb[hha][Tr7.index(triTb[i][0])+4]=-1
    for i in range(0,len(triTb)):
        Tr8=triTb[i][1:4]
        if len(points)-1 in Tr8 or len(points)-2 in Tr8 or len(points)-3 in Tr8:
            bigTri.append(triTb[i])
            triTb[i]=[-1,-1,-1,-1,-1,-1,-1]
    while [-1,-1,-1,-1,-1,-1,-1] in triTb:
        triTb.remove([-1,-1,-1,-1,-1,-1,-1])
    for i in range(0,len(triTb)):
        kt=triTb[i][0]
        for j in range(0,len(triTb)):
            if kt in triTb[j][4:7]:
                triTb[j][triTb[j][4:7].index(kt)+4]=i
        triTb[i][0]=i
    return triTb, bigTri


def triCenteroid(v1x,v1y,v1z,v2x,v2y,v2z,v3x,v3y,v3z):
    x=(v1x+v2x+v3x)/3.0
    y=(v1y+v2y+v3y)/3.0
    z=((v1z+v2z+v3z)/3.0)+20
    return rg.Point3d(x,y,z)

def delaunayTri(pts, numpts, totalpts, allpts, redbox,greenbox,pinkbox,p1box,p2box):
    eps=0
    offx=7
    offy=10
    points=[]
    for i in range(0,len(pts)):
        points.append([i,pts[i].X,pts[i].Y,pts[i].Z])
    #create the big triangle and the corresponding table
    bigTri=SuperTri(allpts)
    triTb=[[0,len(pts),len(pts)+1,len(pts)+2,-1,-1,-1]]
    points.append([len(pts),bigTri[0].X,bigTri[0].Y, bigTri[0].Z])
    points.append([len(pts)+1,bigTri[1].X,bigTri[1].Y,bigTri[1].Z])
    points.append([len(pts)+2,bigTri[2].X,bigTri[2].Y,bigTri[2].Z])
    #initialize the empty meshes
    blueptindex = 0
    bigptindex = 0
    redmesh = rg.Mesh()
    bluemesh = rg.Mesh()
    bigmesh = rg.Mesh()
    outlines = []
    #visualization of Tags and Table
    bary=triCenteroid(points[triTb[0][1]][1],points[triTb[0][1]][2],points[triTb[0][1]][3],points[triTb[0][2]][1],points[triTb[0][2]][2],points[triTb[0][2]][3],points[triTb[0][3]][1],points[triTb[0][3]][2],points[triTb[0][3]][3])
    ay=1
    for ax in range(7):
        posTb.append(rg.Point3d(xt+step*ax,yt-step,0))
        strTb.append(str(triTb[0][ax]))
    posT.append(rg.Point3d(bary[0],bary[1],bary[2]))
    strT.append(str(triTb[0][0]))
    #redbox=[]
    #calculation
    for ii in range(0,numpts):
        checkwhile=0
        checkwhile1=0
        checkwhile2=0
        k=0
        xp=points[ii][1]
        yp=points[ii][2]
        # In every row of triangulation table
        for j in range(0,len(triTb)):
            a = numpy.linalg.det([[points[triTb[k][2]][1],points[triTb[k][2]][2] ,1 ],[points[triTb[k][1]][1],points[triTb[k][1]][2] ,1 ],[xp,yp,1]])
            b = numpy.linalg.det([[points[triTb[k][3]][1],points[triTb[k][3]][2] ,1 ],[points[triTb[k][2]][1],points[triTb[k][2]][2] ,1 ],[xp,yp,1]])
            c = numpy.linalg.det([[points[triTb[k][1]][1],points[triTb[k][1]][2] ,1 ],[points[triTb[k][3]][1],points[triTb[k][3]][2] ,1 ],[xp,yp,1]])
            #is it inside the current 
            if (a>0 and b>0 and c>0) or (a<0 and b<0 and c<0):
                 #if last itteration, add red triangle as target triangle
                 if ii==numpts-1:
                     if numpts != totalpts:
                         for i in range(1,4):
                            redmesh.Vertices.Add(points[triTb[k][i]][1],points[triTb[k][i]][2],points[triTb[k][i]][3]+eps)
                            redmesh.VertexColors.Add(255,0,0)
                         redmesh.Faces.AddFace(0,1,2)
                 tin=k
                 break
            elif ii==numpts-1:
                #outlines.append(rg.Line(points[triTb[k][2]][1], points[triTb[k][2]][2], points[triTb[k][2]][3],points[triTb[k][1]][1], points[triTb[k][1]][2],points[triTb[k][2]][3]))
                if numpts != totalpts:
                    for i in range(1,4):
                        bluemesh.Vertices.Add(points[triTb[k][i]][1],points[triTb[k][i]][2],points[triTb[k][i]][3]+eps)
                        bluemesh.VertexColors.Add(0,0,255)
                    #print "blueblue", k
                    bluemesh.Faces.AddFace(0+blueptindex,1+blueptindex,2+blueptindex)
                    blueptindex+=3
            #is it in front of vertex3, find corresponding triangle
            if ((a>0)and(triTb[k][6]!= -1)):
                k=triTb[k][6]
            #is it in front of vertex1, find corresponding triangle
            elif ((b>0)and(triTb[k][4]!= -1)):
                k=triTb[k][4]
            #is it in front of vertex12, find corresponding triangle
            elif ((c>0)and(triTb[k][5]!= -1)):
                k=triTb[k][5]
        n = len(triTb)
        if triTb[tin][5]!=-1:
            at=triTb[tin][5]
            tk=triTb[at][4:7];
            triTb[at][tk.index(tin)+4]=n
            strTb[(at+1)*7+tk.index(tin)+4]=str(n)
            greenbox[0]=rg.Point3d(posTb[(at+1)*7+tk.index(tin)+4].X-offx,posTb[(at+1)*7+tk.index(tin)+4].Y-offy,0)
        if triTb[tin][6]!=-1:
            at=triTb[tin][6]
            tk=triTb[at][4:7];
            triTb[at][tk.index(tin)+4]=n+1
            strTb[(at+1)*7+tk.index(tin)+4]=str(n+1)
            greenbox[1]=rg.Point3d(posTb[(at+1)*7+tk.index(tin)+4].X-offx,posTb[(at+1)*7+tk.index(tin)+4].Y-offy,0)
        triTb.append([n,points[ii][0],triTb[tin][3],triTb[tin][1],triTb[tin][5],n+1,tin])
        triTb.append([n+1,points[ii][0],triTb[tin][1],triTb[tin][2],triTb[tin][6],tin,n])
        triTb[tin][1]=points[ii][0]
        triTb[tin][5]=n
        triTb[tin][6]=n+1
        ##### Update visualization of table and tags
        for ax in range(7):
            posP=rg.Point3d(xt+step*ax,yt-step*(tin+1),0)
            posId=posTb.index(posP)
            strTb[posId]=str(triTb[tin][ax])
            if ax==1:
                redbox[0]=rg.Point3d(posP.X-offx,posP.Y-offy,0)
            if ax==5:
                redbox[1]=rg.Point3d(posP.X-offx,posP.Y-offy,0)
            if ax==6:
                redbox[2]=rg.Point3d(posP.X-offx,posP.Y-offy,0)
        for ax in range(7):
            posP=rg.Point3d(xt+step*ax,yt-step*(n+1),0)
            posTb.append(posP)
            strTb.append(str(triTb[n][ax]))
            redbox[ax+3]=rg.Point3d(posP.X-offx,posP.Y-offy,0)
        for ax in range(7):
            posP=rg.Point3d(xt+step*ax,yt-step*(n+2),0)
            posTb.append(posP)
            strTb.append(str(triTb[n+1][ax]))
            redbox[ax+10]=rg.Point3d(posP.X-offx,posP.Y-offy,0)
        #tin
        bary=triCenteroid(points[triTb[tin][1]][1],points[triTb[tin][1]][2],points[triTb[tin][1]][3],points[triTb[tin][2]][1],points[triTb[tin][2]][2],points[triTb[tin][2]][3],points[triTb[tin][3]][1],points[triTb[tin][3]][2],points[triTb[tin][3]][3])
        baryp=rg.Point3d(bary[0],bary[1],bary[2])
        posId=strT.index(str(triTb[tin][0]))
        posT[posId]=baryp
        #n
        bary=triCenteroid(points[triTb[n][1]][1],points[triTb[n][1]][2],points[triTb[n][1]][3],points[triTb[n][2]][1],points[triTb[n][2]][2],points[triTb[n][2]][3],points[triTb[n][3]][1],points[triTb[n][3]][2],points[triTb[n][3]][3])
        baryp=rg.Point3d(bary[0],bary[1],bary[2])
        posT.append(baryp)
        strT.append(str(n))
        #n+1
        bary=triCenteroid(points[triTb[n+1][1]][1],points[triTb[n+1][1]][2],points[triTb[n+1][1]][3],points[triTb[n+1][2]][1],points[triTb[n+1][2]][2],points[triTb[n+1][2]][3],points[triTb[n+1][3]][1],points[triTb[n+1][3]][2],points[triTb[n+1][3]][3])
        baryp=rg.Point3d(bary[0],bary[1],bary[2])
        posT.append(baryp)
        strT.append(str(n+1))
        ###Ceck Delaunay Condition
        q=[n+1,n,tin]
        while len(q):
            Ro=q[-1]
            T1=triTb[Ro][4]
            if T1!=-1:
                Tr1=triTb[T1][4:7]
                V4=triTb[T1][Tr1.index(Ro)+1]
                Xc=points[V4][1]
                Yc=points[V4][2]
                x1=points[triTb[Ro][1]][1]
                y1=points[triTb[Ro][1]][2]
                x2=points[triTb[Ro][2]][1]
                y2=points[triTb[Ro][2]][2]
                x3=points[triTb[Ro][3]][1]
                y3=points[triTb[Ro][3]][2]
                Ma=[[x1,y1,x1**2+y1**2,1],[x2,y2,x2**2+y2**2,1],[x3,y3,x3**2+y3**2,1],[Xc,Yc,Xc**2+Yc**2,1]]
                De=numpy.linalg.det(Ma)
                if De>0:
                    checkwhile=1
                    VA=triTb[Ro][0:3]
                    VA.append(V4)
                    Tr2=triTb[T1][1:4]
                    SS1=triTb[T1][Tr2.index(triTb[Ro][3])+4]
                    VA.append(SS1)
                    VA.append(T1)
                    VA.append(triTb[Ro][6])
                    ##
                    VA1=[T1,triTb[Ro][1],V4,triTb[Ro][3]]
                    Tr3=triTb[T1][1:4]
                    ind1=Tr3.index(VA1[2])
                    ind2=Tr3.index(VA1[3])
                    ind3=3-(ind1+ind2)
                    SS2=triTb[T1][ind3+4]
                    SS3=triTb[Ro][Tr3.index(triTb[T1][2])+4]
                    VA1.append(SS2)
                    VA1.append(triTb[Ro][5])
                    VA1.append(Ro)
                    triTb[Ro]=VA
                    # Update Table and Tags
                    for ax in range(7):
                        posP=rg.Point3d(xt+step*ax,yt-step*(Ro+1),0)
                        posId=posTb.index(posP)
                        strTb[posId]=str(triTb[Ro][ax])
                        if ax==0:
                            pinkbox.append(rg.Point3d(posP.X-3*offx,posP.Y-offy,0))
                    bary=triCenteroid(points[triTb[Ro][1]][1],points[triTb[Ro][1]][2],points[triTb[Ro][1]][3],points[triTb[Ro][2]][1],points[triTb[Ro][2]][2],points[triTb[Ro][2]][3],points[triTb[Ro][3]][1],points[triTb[Ro][3]][2],points[triTb[Ro][3]][3])
                    baryp=rg.Point3d(bary[0],bary[1],bary[2])
                    posId=strT.index(str(triTb[Ro][0]))
                    posT[posId]=baryp
                    ####
                    triTb[T1]=VA1
                    # Update Table and Tags
                    bary=triCenteroid(points[triTb[T1][1]][1],points[triTb[T1][1]][2],points[triTb[T1][1]][3],points[triTb[T1][2]][1],points[triTb[T1][2]][2],points[triTb[T1][2]][3],points[triTb[T1][3]][1],points[triTb[T1][3]][2],points[triTb[T1][3]][3])
                    baryp=rg.Point3d(bary[0],bary[1],bary[2])
                    posId=strT.index(str(triTb[T1][0]))
                    posT[posId]=baryp
                    for ax in range(7):
                        posP=rg.Point3d(xt+step*ax,yt-step*(T1+1),0)
                        posId=posTb.index(posP)
                        strTb[posId]=str(triTb[T1][ax])
                        if ax==0:
                            pinkbox.append(rg.Point3d(posP.X-3*offx,posP.Y-offy,0))
                    ####
                    if SS1 !=-1:
                        checkwhile1=1
                        Tr4=triTb[SS1][4:7]
                        triTb[SS1][Tr4.index(T1)+4]=Ro
                        strTb[(SS1+1)*7+Tr4.index(T1)+4]=str(Ro)
                        p1box.append(rg.Point3d(posTb[(SS1+1)*7+Tr4.index(T1)+4].X-offx,posTb[(SS1+1)*7+Tr4.index(T1)+4].Y-offy,0))
                    if SS3!=-1:
                        checkwile2=1
                        Tr5=triTb[SS3][4:7]
                        triTb[SS3][Tr5.index(Ro)+4]=T1
                        strTb[(SS3+1)*7+Tr5.index(Ro)+4]=str(T1)
                        p2box.append(rg.Point3d(posTb[(SS3+1)*7+Tr5.index(Ro)+4].X-offx,posTb[(SS3+1)*7+Tr5.index(Ro)+4].Y-offy,0))
                    q.append(T1)
                else:
                    q.remove(q[-1])
                    
            else:
                q.remove(q[-1])
        if not checkwhile:
            pinkbox=[]
            p1box=[]
            p2box=[]
        #if not checkwhile1:
            #p1box=[]
        #if not checkwhile2:
            #p2box=[]
    triTb, biggerTri = removeSuperTri(triTb,points)
    if numpts != totalpts:
        for row in biggerTri:
            for i in range(1,4):
                bigmesh.Vertices.Add(points[row[i]][1],points[row[i]][2],points[row[i]][3])
            bigmesh.Faces.AddFace(0+bigptindex,1+bigptindex,2+bigptindex)
            bigptindex+=3
    return triTb, bigmesh, redmesh, bluemesh, points,redbox,greenbox,pinkbox,p1box,p2box

def creat_triMesh(pts,triTb):
    mesh = rg.Mesh()
    triNormal=[]
    vertexN=[]
    for i in range(0,len(pts)):
        mesh.Vertices.Add(pts[i][0], pts[i][1], pts[i][2])
        vertexN.append([0,0,0,0])
    for i in range(0,len(triTb)):
        mesh.Faces.AddFace(triTb[i][1],triTb[i][2],triTb[i][3])
        vlist=triTb[i][1:4]
        triN=Vnorm(vlist,pts)
        triNormal.append(Vnorm(vlist,pts))
        for vIndex in vlist:
                vertexN[vIndex][0]=vertexN[vIndex][0]+triN[0]
                vertexN[vIndex][1]=vertexN[vIndex][1]+triN[1]
                vertexN[vIndex][2]=vertexN[vIndex][2]+triN[2]
                vertexN[vIndex][3]=vertexN[vIndex][3]+1
    return mesh,vertexN 

def filterPoints(pts,factor):
    fltPts=[]
    for i in range(0,len(pts),factor):
        if i<len(pts):
            fltPts.append(pts[i])
    return fltPts


halfstep=3*step/4.0
bigstep=step*7
farPoint=-1000
xt=1500
yt=800
posTb=[]
for i in range(7):
    posTb.append(rg.Point3d(xt+step*i,yt,0))
strTb=['ID','V1','V2','V3','T1','T2','T3']
posT=[]
strT=[]
redbox=[1,1,1,1,1,1,1,1,1,1,1,1,1,1,1,1,1]
greenbox=[1,1]
pinkbox=[]
prebox=[]
p1box=[]
p2box=[]
boundpts = SuperTri(pts)
pts_select=pts[0:int(Numpts)]
if int(Numpts) != len(pts):
    target_pt=pts[int(Numpts)-1]
triTb, bigmesh, redmesh, bluemesh, points,redbox,greenbox,pinkbox,p1box,p2box = delaunayTri(pts_select,int(Numpts),len(pts),pts,redbox,greenbox,pinkbox,p1box,p2box)
#print pinkbox
triMesh,normalV=creat_triMesh(pts,triTb)
#show the edges of the mesh
facelist = triMesh.Faces
edgelist = triMesh.TopologyEdges
linelist = []
for i in range(0,facelist.Count):
    edge_ilist = edgelist.GetEdgesForFace(i)
    for el in edge_ilist:
        linelist.append(edgelist.EdgeLine(el))
#show the edges of the big triangle
if int(Numpts) != len(pts):
    bigfacelist = bigmesh.Faces
    bigedgelist = bigmesh.TopologyEdges
    biglinelist = []
    for i in range(0,bigfacelist.Count):
        edge_ilist = bigedgelist.GetEdgesForFace(i)
        for el in edge_ilist:
            biglinelist.append(bigedgelist.EdgeLine(el))
else:
    posTb=[]
    for i in range(7):
        posTb.append(rg.Point3d(xt+step*i,yt,0))
    strTb=['ID','V1','V2','V3','T1','T2','T3']
    posT=[]
    strT=[]
    pinkbox=[]
    redbox=[]
    greenbox=[]
    p1box=[]
    p2box=[]
    for i in range(len(triTb)):
        bary=triCenteroid(points[triTb[i][1]][1],points[triTb[i][1]][2],points[triTb[i][1]][3],points[triTb[i][2]][1],points[triTb[i][2]][2],points[triTb[i][2]][3],points[triTb[i][3]][1],points[triTb[i][3]][2],points[triTb[i][3]][3])
        baryp=rg.Point3d(bary[0],bary[1],bary[2])
        posT.append(baryp)
        strT.append(str(triTb[i][0]))
        for ax in range(7):
            posP=rg.Point3d(xt+step*ax,yt-step*(i+1),0)
            posTb.append(posP)
            strTb.append(str(triTb[i][ax]))
# ---------- end python_2 ----------
preview = CustomPreview(Geometry=python_2.biglinelist, Shader=ColourSwatch(SwatchColor=RGB(171, 164, 75)))
preview_2 = CustomPreview(Geometry=python_2.linelist, Shader=ColourSwatch(SwatchColor=RGB(0, 0, 0)))
xy = XYPlane(Origin=python_2.posTb)
xy_2 = XYPlane(Origin=python_2.p1box)
mesh = Mesh(python_2.bluemesh)
mesh_2 = Mesh(python_2.redmesh)
xy_3 = XYPlane(Origin=python_2.pinkbox)
xy_4 = XYPlane(Origin=python_2.p2box)
xy_5 = XYPlane(Origin=python_2.greenbox)
xy_6 = XYPlane(Origin=python_2.redbox)
sph = Sphere(Base=python_2.target_pt, Radius=Slider(26, range=0..50))
preview_3 = CustomPreview(Geometry=sph, Shader=ColourSwatch(SwatchColor=RGB(255, 255, 0)))
xy_7 = XYPlane(Origin=python_2.posT)
rectangle = Rectangle(Plane=xy_5, XSize=python_2.halfstep, YSize=python_2.halfstep, Radius=0)  # -> Rectangle, Length
rectangle_2 = Rectangle(Plane=xy_2, XSize=python_2.halfstep, YSize=python_2.halfstep, Radius=0)  # -> Rectangle, Length
rectangle_3 = Rectangle(Plane=xy_4, XSize=python_2.halfstep, YSize=python_2.halfstep, Radius=0)  # -> Rectangle, Length
rectangle_4 = Rectangle(Plane=xy_6, XSize=python_2.halfstep, YSize=python_2.halfstep, Radius=0)  # -> Rectangle, Length
tag = TextTag3D(
    Location=xy,
    Text=python_2.strTb,
    Size=Slider(31, range=0..100),
    Colour=ColourSwatch(SwatchColor=RGB(0, 0, 255)),
    Justification=7)
tag_2 = TextTag3D(
    Location=xy_7,
    Text=python_2.strT,
    Size=Slider(31, range=0..100),
    Colour=ColourSwatch(SwatchColor=RGB(0, 0, 0)),
    Justification=7)
preview_4 = CustomPreview(Geometry=rectangle_4.Rectangle, Shader=ColourSwatch(SwatchColor=RGB(255, 0, 0)))
preview_5 = CustomPreview(Geometry=rectangle.Rectangle, Shader=ColourSwatch(SwatchColor=RGB(7, 125, 33)))
rectangle_5 = Rectangle(Plane=xy_3, XSize=python_2.bigstep, YSize=python_2.halfstep, Radius=0)  # -> Rectangle, Length
preview_6 = CustomPreview(Geometry=rectangle_2.Rectangle, Shader=ColourSwatch(SwatchColor=RGB(97, 0, 0)))
preview_7 = CustomPreview(Geometry=rectangle_3.Rectangle, Shader=ColourSwatch(SwatchColor=RGB(97, 0, 0)))
preview_8 = CustomPreview(Geometry=rectangle_5.Rectangle, Shader=ColourSwatch(SwatchColor=RGB(255, 0, 255)))
mesh_3 = Mesh()
